# Grasshopper definition SemesterProject3for2_v7.gh (Grasshopper 0.9.76)
# plug-ins: Python Interpreter, PTComponentLibrary, LunchBox

# Geometry
# properties
number_slider = Slider(0.3, range=0..1)

# ---- group: For doing a reference line on rhino with the height of the PV
height_pv_all_orientations = Slider(1.175, range=0..1.7)
neg = Negative(Value=height_pv_all_orientations)
pt = Point(<point referenced from the Rhino model>)
Z = UnitZ(Factor=expr("x*1000", neg))
move = Move(Geometry=pt, Motion=Z)  # -> Geometry, Transform
ln = Line(StartPoint=pt, EndPoint=move.Geometry)

# ----
# Open
# EPW
toggle = BooleanToggle(False)
ladybug = Ladybug_Ladybug()  # -> Vviiiiiiiiiizzz; plug-in component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
open_weather_file = Ladybug_OpenEPWWeatherFile(open=toggle)  # -> epwFile; plug-in component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
importepw = Ladybug_ImportEpw(epwFile=open_weather_file)  # -> readMe, latitude, location, dryBulbTemperature, dewPointTemperature, relativeHumidity, windSpeed, windDirection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; plug-in component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

neg_2 = Negative(Value=number_slider)
rotation_step_5 = Slider(0, range=0..18, expression="x*Pi/36")

height_pv = Slider(8, range=1..14, expression="tan(x*Pi/36)*1.1")
height_1_degree = Slider(44, range=15..45, expression="tan(x*Pi/180)*1.1")
height_pv_circle = Slider(8, range=1..14, expression="tan(x*Pi/36)*1.1")
depth_pv_south = Slider(1.1, range=0..1.5)
depth_pv_west = Slider(1.1, range=0..1.5)
depth_pv_east = Slider(0, range=0..1.5)
depth_pv_north = Slider(1.1, range=0..1.5)

# ----
# Change
# Geometry
height_pv_all_orientations_2 = Slider(0.3, range=0..1.7)

depth_pv = Slider(1, range=0..1.5)
Z_2 = UnitZ(Factor=neg_2)

# ---- group: Building parameters
amount_of_floors = Slider(35, range=1..60)
floor_side_size = Slider(30, range=0..100)
floor_height = Slider(3.65, range=0..10)

# ----
# East  = 1
# North = 2
# West  = 3
# South = 0
number_slider_2 = Slider(1, range=0..3)

# ---- group: Depth PV South
number_slider_3 = Slider(1.2, range=0..10)
number_slider_4 = Slider(1.2, range=0..10)

# ---- group: Depth PV North
number_slider_5 = Slider(1.2, range=0..10)
number_slider_6 = Slider(1.2, range=0..10)

# ---- group: Depth PV West
number_slider_7 = Slider(1.74, range=0..10)
number_slider_8 = Slider(1.74, range=0..10)

# ---- group: Depth PV East
number_slider_9 = Slider(1.74, range=0..10)
number_slider_10 = Slider(1.74, range=0..10)

# ----
rtrig = RightTrigonometry(Alpha=Slider(1, range=0..1, expression="9/2*Pi"))  # -> Alpha, Beta, PLength, QLength, RLength

# ---- group: Remove direct
toggle_2 = BooleanToggle(False)

# ----
# Optimization
galapagos = Galapagos(fitness=division_5, gene=[depth_pv_north, depth_pv_east, height_pv_all_orientations_2])

# ----
# 2 - Choose grid size
# 3 - Choose legend parameter
# 4 - Choose and connect analysis period
# at the green panel
# *change day if needed at the analysis period tab
# 5 - Choose if want to remove direct or diffuse
list = ValueList({"One floor": 8.1, "One facade": 130, "Whole Building": 1620, "One floor one day": 1.45}, selected="One floor one day")

month = Slider(12, range=1..12)
hour = Slider(24, range=1..24)
month_2 = Slider(1, range=1..12)
day = Slider(31, range=1..31)
day_2 = Slider(1, range=1..31)
hour_2 = Slider(1, range=1..24)
analysisperiod = Ladybug_AnalysisPeriod(fromMonth=month_2, fromDay=day_2, fromHour=hour_2, toMonth=month, toDay=day, toHour=hour)  # -> readMe, analysisPeriod; plug-in component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

dom = ConstructDomain(DomainStart=depth_pv, DomainEnd=depth_pv)
dom_2 = ConstructDomain(DomainStart=depth_pv, DomainEnd=depth_pv)
dom_3 = ConstructDomain(DomainStart=depth_pv, DomainEnd=depth_pv)

# ---- group: Remove diffuse (the component is the opposite)
toggle_3 = BooleanToggle(False)

# ----
dom_4 = ConstructDomain(DomainStart=depth_pv, DomainEnd=depth_pv)

# ---- group: Daily analysis period
hour_3 = Slider(1, range=1..23)
day_31 = Slider(20, range=1..31)
month_3 = Slider(3, range=1..12)
addition = Addition(A=hour_3, B=1)
analysisperiod_2 = Ladybug_AnalysisPeriod(fromMonth=month_3, fromDay=day_31, fromHour=hour_3, toMonth=month_3, toDay=day_31, toHour=addition)  # -> readMe, analysisPeriod; plug-in component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

# ---- group: Montlhy analysis period
day_3 = Slider(31, range=1..31)
hour_4 = Slider(24, range=1..24)
month_4 = Slider(1, range=1..12)
day_4 = Slider(1, range=1..31)
hour_5 = Slider(1, range=1..24)
analysisperiod_3 = Ladybug_AnalysisPeriod(fromMonth=month_4, fromDay=day_4, fromHour=hour_5, toMonth=month_4, toDay=day_3, toHour=hour_4)  # -> readMe, analysisPeriod; plug-in component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

# ----
number_slider_11 = Slider(0.125, range=0..1)  # disabled
number_slider_12 = Slider(0.005, range=0..0.01)  # disabled

range = Range(Domain=dom_3, Steps=expr("x-1", amount_of_floors))  # -> reverse(Range)

number_slider_13 = Slider(0.005, range=0..0.01)

range_2 = Range(Domain=dom_2, Steps=expr("x-1", amount_of_floors))  # -> reverse(Range)
range_3 = Range(Domain=dom, Steps=expr("x-1", amount_of_floors))  # -> reverse(Range)
range_4 = Range(Domain=dom_4, Steps=expr("x-1", amount_of_floors))  # -> reverse(Range)
_6_1_run_different_vertical_angles = BooleanToggle(False)
_6_1_run_different_orientations = BooleanToggle(False)
panel = Panel(range)
neg_3 = Negative(Value=height_pv_all_orientations_2)
Z_3 = UnitZ(Factor=neg_3)

# ---- group: Do not change
list_2 = ValueList({"East": 1, "North": 2, "West": 3, "South": 0}, selected="South")
list_3 = ValueList({"East": 1, "North": 2, "West": 3, "South": 0}, selected="East")
list_4 = ValueList({"East": 1, "North": 2, "West": 3, "South": 0}, selected="North")
list_5 = ValueList({"East": 1, "North": 2, "West": 3, "South": 0}, selected="West")

# ----
fly = Ladybug_fly(inputSliders=height_pv_circle, fly=_6_1_run_different_vertical_angles)  # -> Vviiiiiiiiiizzz; plug-in component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

# ---- group: Legend
legendpar = Ladybug_LegendParameters(lowBound=0, highBound=list, legendScale=Slider(0.2, range=0..10), fontSize=Slider(0.2, range=0..10))  # -> legendPar; plug-in component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

# ----
fly_2 = Ladybug_fly(inputSliders=rotation_step_5, fly=_6_1_run_different_orientations)  # -> Vviiiiiiiiiizzz; plug-in component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

_1_floor = Slider(0, range=0..34)

# ---- group: Connect one geometry from here
# or one facade
# (choose orientation)
# or one floor one facade
# (choose orientation and floor)
_1_floor_2 = Slider(0, range=0..34)

# or one facade
# (choose orientation)
# or one floor one facade
# (choose orientation and floor)
_1_floor_3 = Slider(1, range=0..34)
list_6 = ValueList({"East": 1, "North": 2, "West": 3, "South": 0}, selected="East")

# ----
# PV tech
# application
# Crystalline
# CGIS 1
# CGIS 2
toggle_4 = BooleanToggle(False)  # disabled
fly_3 = Ladybug_fly(inputSliders=Slider(1.8, range=0.5..2), fly=toggle_4)  # -> Vviiiiiiiiiizzz; disabled; plug-in component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
number_slider_14 = Slider(0.1, range=0..1)  # disabled
neg_4 = Negative(Value=number_slider_14)  # disabled
X = UnitX(Factor=neg_4)  # disabled
evf = EvaluateField()  # -> Tensor, Strength; disabled

number_slider_15 = Slider(0.21, range=0..1)  # disabled
number_slider_16 = Slider(0.02, range=0..0.2)  # disabled
number_slider_17 = Slider(5, range=0..10)  # disabled

# ----
# 6 - Set up and enable simulation
# 7 - Choose and run simulation
d_enable_image_saving = BooleanToggle(False)
_6_2_run_hourly = BooleanToggle(False)
_6_1_run_monthly = BooleanToggle(False)
b_enable_simulation = BooleanToggle(True)
a_sky = BooleanToggle(True)

# ----
# Connect analysis
# period =======>
gencumulativeskymtx = Ladybug_GenCumulativeSkyMtx(epwFile=open_weather_file, skyDensity=0, useOldRes=True, runIt=a_sky)  # -> readMe, cumulativeSkyMtx; plug-in component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
selectskymtx = Ladybug_selectSkyMtx(
    cumulativeSkyMtx=gencumulativeskymtx.cumulativeSkyMtx,
    analysisPeriod=analysisperiod_2.analysisPeriod,
    removeDiffuse=toggle_2,
    removeDirect=toggle_3)  # -> readMe, selectedSkyMtx; plug-in component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

# ----
# Solar radiation
fly_4 = Ladybug_fly(inputSliders=hour_3, fly=_6_2_run_hourly)  # -> Vviiiiiiiiiizzz; plug-in component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

# ---- group: Images saving
panel_2 = Panel("G:\My Drive\_ETH\ETH.4 sem\Semester project\Solar radiation studies\Images\daily east")
captureview = Ladybug_CaptureView(fileName=hour_3, folder=panel_2, transparBack=Toggle(True), capture=d_enable_image_saving)  # -> imagePath; plug-in component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

# ----
addition_2 = Addition(A=number_slider_15, B=number_slider_16)  # -> flatten(Result); disabled
neg_5 = Negative(Value=number_slider_16)  # disabled
number_slider_18 = Slider(0.02, range=0..10)  # disabled

neg_6 = Negative(Value=Slider(0.02, range=0..1))

addition_3 = Addition(A=number_slider_11, B=number_slider_12)  # disabled
neg_7 = Negative(Value=number_slider_12)  # disabled
number_slider_19 = Slider(0.02, range=0..10)  # disabled

multiplication = Multiplication(A=addition_2, B=number_slider_17)  # disabled

addition_4 = Addition(A=Slider(0.125, range=0..1), B=number_slider_13)
pt_2 = Point()
neg_8 = Negative(Value=number_slider_13)

fly_5 = Ladybug_fly(inputSliders=month_4, fly=_6_1_run_monthly)  # -> Vviiiiiiiiiizzz; plug-in component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

number_slider_20 = Slider(0.01, range=0..0.1)

number_slider_21 = Slider(0.01, range=0..0.1)

number_slider_22 = Slider(0.01, range=0..0.1)  # disabled

series = Series(Start=floor_height, Step=floor_height, Count=amount_of_floors)
planesrf = PlaneSurface(Plane=PlaneXY(0, 0, 0), XSize=floor_side_size, YSize=floor_side_size)
neg_9 = Negative(Value=height_pv_all_orientations_2)
Z_4 = UnitZ(Factor=series)
Z_5 = UnitZ(Factor=neg_9)

# ---- group: Geometry test (flat)
geo = Geometry(planesrf)

# ---- group: extract surface from polysurface
brep = Brep(geo)
debrep = DeconstructBrep(Brep=brep)  # -> Faces, Edges, Vertices
item = ListItem(List=debrep.Faces, Index=0, Wrap=True)

# ----
cluster = Cluster(T_2=Z_4, T=Z_4, D=range, x=height_pv_circle, x_2=floor_height)  # -> G, L_2, L
circle_shape_context = Geometry([cluster.G, cluster.L_2])
rotate = Rotate(Geometry=planesrf, Angle=rotation_step_5, Plane=PlaneXY(0, 0, 0))  # -> Geometry, Transform
circle_shape_pv = Geometry(cluster.L)
one_floor = ListItem(List=flatten(circle_shape_pv), Index=_1_floor, Wrap=True)
panel_3 = Panel(one_floor)
area = Area(Geometry=one_floor)  # -> Area, Centroid

dam = DataDam(DataA=one_floor, BufferDelay=10000000, BufferMode=0)
srf = Surface(dam)
# Crystalline
# circle
area_2 = Area(Geometry=srf)  # -> Area, Centroid

brep_2 = Brep(srf)
ptsrfdis = SurfaceDistance(Surface=srf, U_dis=addition_4, V_dis=addition_4, Extend=True)
pttrim = TrimGrid(Grid=ptsrfdis, BRep=brep_2, Mode=0)
ptcell = Cellulate(Grid=pttrim)  # -> Wires, Cells, Meshes
crv = Curve(ptcell.Wires)
join = JoinCurves(Curves=crv, Preserve=False)
offset = Offset(Curve=join, Distance=neg_8, Plane=srf, Corners=1)
fillet = FilletDistance(Curve=offset, Distance=Slider(0.02, range=0..10))
explode = Explode(Curve=fillet, Recursive=True)  # -> Segments, Vertices
pline = PolyLine(Vertices=explode.Vertices, Closed=False)

ptoffsetgrid = OffsetGrid(Grid=pttrim, BRep=brep_2, Dis=number_slider_21)
pt3dcell = Cellulate3DGrid(Grid1=pttrim, Grid2=ptoffsetgrid)  # -> Wires, Cells, Boxes

move_2 = Move(Geometry=rotate.Geometry, Motion=Z_4)  # -> Geometry, Transform
rec = Rectangle(move_2.Geometry)
explode_2 = Explode(Curve=rec, Recursive=True)  # -> Segments, Vertices
item_2 = ListItem(List=explode_2.Segments, Index=list_5, Wrap=True)
item_3 = ListItem(List=explode_2.Segments, Index=list_3, Wrap=True)
item_4 = ListItem(List=explode_2.Segments, Index=list_4, Wrap=True)
item_5 = ListItem(List=explode_2.Segments, Index=list_2, Wrap=True)

srf_2 = Surface(pline)
area_3 = Area(Geometry=srf_2)  # -> flatten(Area), Centroid
evalsrf = EvaluateSurface(Surface=reparameterize(srf_2), Point=pt_2)  # -> Point, Normal, Frame
offset_2 = Offset(Surface=srf_2, Distance=number_slider_21, Retrim=True)
ma = MassAddition(Input=area_3.Area)  # -> Result, PartialResults
subtraction = Subtraction(A=evalsrf.Normal)
neg_10 = Negative(Value=evalsrf.Normal)
extr = Extrude(Base=offset_2, Direction=neg_10)
division = Division(A=ma.Result, B=area_2.Area)
panel_4 = Panel(ma.Result)
trim = TrimSolid(Shape=extr, Cutters=srf)
panel_5 = Panel(division)

rec_2 = DataRecorder(division, DataLimit=-10, RecordData=True)

floors_slabs = Geometry(move_2.Geometry)

extr_2 = Extrude(Base=floors_slabs, Direction=Z_2)
cap = CapHoles(Brep=extr_2)

# ---- group: Area of geometry
area_4 = Area(Geometry=flatten(floors_slabs))  # -> Area, Centroid
ma_2 = MassAddition(Input=area_4.Area)  # -> Result, PartialResults
subtraction_2 = Subtraction(A=ma_2.Result, B=900)
panel_6 = Panel(subtraction_2)

# ---- group: East
flatten = FlattenTree(Tree=item_3, Path="{0}")
offset_3 = Offset(Curve=flatten, Distance=range, Plane=rec, Corners=1)

# ----
cluster_2 = Cluster_2(C=offset_3, C_2=planesrf, i=list_3, x=floor_side_size, location=importepw.location, month=month_4, G=planesrf)

# ---- group: South
flatten_2 = FlattenTree(Tree=item_5, Path="{0}")
offset_4 = Offset(Curve=flatten_2, Distance=range_4, Plane=rec, Corners=1)

# ----
llx = LineLine(Line1=offset_3, Line2=offset_4)  # -> ParamA, ParamB, PointA, PointB

# ---- group: North
flatten_3 = FlattenTree(Tree=item_4, Path="{0}")
offset_5 = Offset(Curve=flatten_3, Distance=range_2, Plane=rec, Corners=1)

# ----
llx_2 = LineLine(Line1=offset_3, Line2=offset_5)  # -> ParamA, ParamB, PointA, PointB
ln_2 = Line(StartPoint=llx_2.PointA, EndPoint=llx.PointB)

# ---- group: East (continued)
move_3 = Move(Geometry=ln_2, Motion=Z_5)  # -> Geometry, Transform

# ----
end = EndPoints(Curve=item_3)  # -> Start, End
end_2 = EndPoints(Curve=move_3.Geometry)  # -> Start, End
ln_3 = Line(StartPoint=end.Start, EndPoint=end_2.End)
ln_4 = Line(StartPoint=end.End, EndPoint=end_2.Start)

# ---- group: West
flatten_4 = FlattenTree(Tree=item_2, Path="{0}")
offset_6 = Offset(Curve=flatten_4, Distance=range_3, Plane=rec, Corners=1)

# ----
llx_3 = LineLine(Line1=offset_5, Line2=offset_6)  # -> ParamA, ParamB, PointA, PointB
llx_4 = LineLine(Line1=offset_6, Line2=offset_4)  # -> ParamA, ParamB, PointA, PointB
ln_5 = Line(StartPoint=llx.PointA, EndPoint=llx_4.PointB)
ln_6 = Line(StartPoint=llx_4.PointA, EndPoint=llx_3.PointB)
ln_7 = Line(StartPoint=llx_3.PointA, EndPoint=llx_2.PointB)

# ---- group: West (continued)
move_4 = Move(Geometry=ln_6, Motion=Z_5)  # -> Geometry, Transform

# ---- group: South (continued)
move_5 = Move(Geometry=ln_5, Motion=Z_3)  # -> Geometry, Transform

# ---- group: North (continued)
move_6 = Move(Geometry=ln_7, Motion=Z_3)  # -> Geometry, Transform

# ----
end_3 = EndPoints(Curve=item_2)  # -> Start, End
end_4 = EndPoints(Curve=move_4.Geometry)  # -> Start, End
ln_8 = Line(StartPoint=end_3.Start, EndPoint=end_4.End)
ln_9 = Line(StartPoint=end_3.End, EndPoint=end_4.Start)

end_5 = EndPoints(Curve=item_5)  # -> Start, End
end_6 = EndPoints(Curve=move_5.Geometry)  # -> Start, End
ln_10 = Line(StartPoint=end_5.Start, EndPoint=end_6.End)
ln_11 = Line(StartPoint=end_5.End, EndPoint=end_6.Start)

end_7 = EndPoints(Curve=item_4)  # -> Start, End
end_8 = EndPoints(Curve=move_6.Geometry)  # -> Start, End
ln_12 = Line(StartPoint=end_7.Start, EndPoint=end_8.End)
ln_13 = Line(StartPoint=end_7.End, EndPoint=end_8.Start)

# ---- group: PV surfaces
pv_south = Loft(Curves=[ln_11, ln_10], Options={Adjust=False, Closed=False, LoftEnds=0, LoftSimp=0, LoftType=0, Rebuild=10, Refit=0.01})
pv_north = Loft(Curves=[ln_13, ln_12], Options={Adjust=False, Closed=False, LoftEnds=0, LoftSimp=0, LoftType=0, Rebuild=10, Refit=0.01})
pv_west = Loft(Curves=[ln_9, ln_8], Options={Adjust=False, Closed=False, LoftEnds=0, LoftSimp=0, LoftType=0, Rebuild=10, Refit=0.01})
pv_east = Loft(Curves=[ln_4, ln_3], Options={Adjust=False, Closed=False, LoftEnds=0, LoftSimp=0, LoftType=0, Rebuild=10, Refit=0.01})

# ----
pv_surfaces = Geometry([pv_south, pv_east, pv_north, pv_west])
pvs = ListItem(List=pv_surfaces, Index=number_slider_2, Wrap=True)  # -> flatten(Item)
one_floor_one_facade = ListItem(List=pvs, Index=_1_floor_2, Wrap=True)

# ---- group: Connect one geometry from here (continued)
all_facades_pvs = Geometry(pv_surfaces)
one_floor_one_facade_2 = Geometry(one_floor_one_facade)
one_whole_facade = Geometry(pvs)

# ---- group: Surface normal direction check
evalsrf_2 = EvaluateSurface(Surface=reparameterize(one_whole_facade), Point="0.5,0.5")  # -> Point, Normal, Frame
vdis = VectorDisplay(Anchor=evalsrf_2.Point, Vector=expr("x*10", evalsrf_2.Normal))

# ----
panel_7 = Panel(pv_surfaces)

pvs_2 = ListItem(List=pv_surfaces, Index=3, Wrap=True)  # -> flatten(Item)
pvs_3 = ListItem(List=pv_surfaces, Index=1, Wrap=True)  # -> flatten(Item)
pvs_4 = ListItem(List=pv_surfaces, Index=0, Wrap=True)  # -> flatten(Item)
pvs_5 = ListItem(List=pv_surfaces, Index=2, Wrap=True)  # -> flatten(Item)

one_floor_one_facade_3 = ListItem(List=pvs_2, Index=_1_floor, Wrap=True)
one_floor_one_facade_4 = ListItem(List=pvs_5, Index=_1_floor, Wrap=True)
one_floor_one_facade_5 = ListItem(List=pvs_3, Index=_1_floor, Wrap=True)
one_floor_one_facade_6 = ListItem(List=pvs_4, Index=_1_floor, Wrap=True)

geo_2 = Geometry(one_floor_one_facade_6)
geo_3 = Geometry(one_floor_one_facade_5)
geo_4 = Geometry(one_floor_one_facade_4)
geo_5 = Geometry(one_floor_one_facade_3)
geo_6 = Geometry(geo_2)

dam_2 = DataDam(DataA=geo_6, BufferDelay=10000000, BufferMode=0)
srf_3 = Surface(dam_2)
area_5 = Area(Geometry=srf_3)  # -> Area, Centroid

srf_4 = Surface(dam_2)  # disabled

crv_2 = Curve(srf_3)  # disabled
pcen = PolygonCenter(Polyline=crv_2)  # -> CenterV, CenterE, CenterA; disabled
pt_3 = Point(pcen.CenterV)  # disabled
brep_3 = Brep(srf_3)  # disabled
ptsrfdis_2 = SurfaceDistance(Surface=srf_3, U_dis=addition_3, V_dis=addition_3, Extend=True, RefPt=pcen.CenterA)  # disabled
pttrim_2 = TrimGrid(Grid=ptsrfdis_2, BRep=brep_3, Mode=0)  # disabled
ptcell_2 = Cellulate(Grid=pttrim_2)  # -> Wires, Cells, Meshes; disabled
crv_3 = Curve(ptcell_2.Wires)  # disabled
join_2 = JoinCurves(Curves=crv_3, Preserve=False)  # disabled
offset_7 = Offset(Curve=join_2, Distance=neg_7, Plane=srf_3, Corners=1)  # disabled
fillet_2 = FilletDistance(Curve=offset_7, Distance=number_slider_19)  # disabled
explode_3 = Explode(Curve=fillet_2, Recursive=True)  # -> Segments, Vertices; disabled
pline_2 = PolyLine(Vertices=explode_3.Vertices, Closed=False)  # disabled

ptoffsetgrid_2 = OffsetGrid(Grid=pttrim_2, BRep=brep_3, Dis=number_slider_20)  # disabled
pt3dcell_2 = Cellulate3DGrid(Grid1=pttrim_2, Grid2=ptoffsetgrid_2)  # -> Wires, Cells, Boxes; disabled

srf_5 = Surface(pline_2)  # disabled
area_6 = Area(Geometry=srf_5)  # -> flatten(Area), Centroid; disabled
evalsrf_3 = EvaluateSurface(Surface=reparameterize(srf_5), Point=pt_3)  # -> Point, Normal, Frame; disabled
offset_8 = Offset(Surface=srf_5, Distance=number_slider_20, Retrim=True)  # disabled
ma_3 = MassAddition(Input=area_6.Area)  # -> Result, PartialResults; disabled
subtraction_3 = Subtraction(A=evalsrf_3.Normal)  # disabled
neg_11 = Negative(Value=evalsrf_3.Normal)  # disabled
extr_3 = Extrude(Base=offset_8, Direction=neg_11)  # disabled
division_2 = Division(A=ma_3.Result, B=area_5.Area)  # disabled
panel_8 = Panel(ma_3.Result)  # disabled
trim_2 = TrimSolid(Shape=extr_3, Cutters=srf_3)  # disabled
panel_9 = Panel(division_2)  # disabled

# ----
# 1 - Choose at the white panel below connect
# geometry, then run geometry and context
dam_3 = DataDam(DataGeometry=one_floor_one_facade_2, BufferDelay=10000000, BufferMode=0)

# ---- group: Area of geometry (continued)
area_7 = Area(Geometry=flatten(one_whole_facade))  # -> Area, Centroid
ma_4 = MassAddition(Input=area_7.Area)  # -> Result, PartialResults

# ----
rec_3 = DataRecorder(ma_4.Result, DataLimit=-10, RecordData=True)

# ---- group: Area of geometry (continued)
panel_10 = Panel(rec_3)

# ----
panel_11 = Panel(area_5.Area)
rec_4 = DataRecorder(division_2, DataLimit=-10, RecordData=True)  # disabled

quads = QuadPanels(Surface=dam_2, UDivisions=11, VDivisions=4)

crv_4 = Curve(srf_4)  # disabled
brep_4 = Brep(srf_4)  # disabled

pcen_2 = PolygonCenter(Polyline=crv_4)  # -> CenterV, CenterE, CenterA; disabled
move_7 = Move(Geometry=pcen_2.CenterV, Motion=X)  # -> Geometry, Transform; disabled
panel_12 = Panel(move_7.Geometry)  # disabled

ptsrfdis_3 = SurfaceDistance(Surface=srf_4, U_dis=multiplication, V_dis=addition_2, Extend=True, RefPt=move_7.Geometry)  # disabled
pttrim_3 = TrimGrid(Grid=ptsrfdis_3, BRep=brep_4, Mode=0)  # disabled
ptcell_3 = Cellulate(Grid=pttrim_3)  # -> Wires, Cells, Meshes; disabled
crv_5 = Curve(ptcell_3.Wires)  # disabled
join_3 = JoinCurves(Curves=crv_5, Preserve=False)  # disabled
offset_9 = Offset(Curve=join_3, Distance=neg_5, Plane=srf_4, Corners=1)  # disabled
fillet_3 = FilletDistance(Curve=offset_9, Distance=number_slider_18)  # disabled
explode_4 = Explode(Curve=fillet_3, Recursive=True)  # -> Segments, Vertices; disabled
pline_3 = PolyLine(Vertices=explode_4.Vertices, Closed=False)  # disabled

ptoffsetgrid_3 = OffsetGrid(Grid=pttrim_3, BRep=brep_4, Dis=number_slider_22)  # disabled
pt3dcell_3 = Cellulate3DGrid(Grid1=pttrim_3, Grid2=ptoffsetgrid_3)  # -> Wires, Cells, Boxes; disabled

srf_6 = Surface(pline_3)  # disabled
evalsrf_4 = EvaluateSurface(Surface=reparameterize(srf_6))  # -> Point, Normal, Frame; disabled
area_8 = Area(Geometry=srf_6)  # -> flatten(Area), Centroid; disabled
offset_10 = Offset(Surface=srf_6, Distance=number_slider_22, Retrim=True)  # disabled
ma_5 = MassAddition(Input=area_8.Area)  # -> Result, PartialResults; disabled
subtraction_4 = Subtraction(A=evalsrf_4.Normal)  # disabled
neg_12 = Negative(Value=evalsrf_4.Normal)  # disabled
panel_13 = Panel(ma_5.Result)  # disabled
extr_4 = Extrude(Base=offset_10, Direction=neg_12)  # disabled
division_3 = Division(A=ma_5.Result, B=area_5.Area)  # disabled
panel_14 = Panel(division_3)  # disabled
trim_3 = TrimSolid(Shape=extr_4, Cutters=srf_4)  # disabled

join_4 = JoinCurves(Curves=quads, Preserve=False)

offset_11 = Offset(Curve=join_4, Distance=neg_6, Plane=PlaneXY(0, 0, 0), Corners=1)
srf_7 = Surface(offset_11)

offset_12 = Offset(Surface=srf_7, Distance=number_slider_20, Retrim=True)
area_9 = Area(Geometry=srf_7)  # -> flatten(Area), Centroid
dim = Dimensions(Surface=offset_12)  # -> UDimension, VDimension
ma_6 = MassAddition(Input=area_9.Area)  # -> Result, PartialResults
panel_15 = Panel(dim.UDimension)
panel_16 = Panel(ma_6.Result)
division_4 = Division(A=ma_6.Result, B=area_5.Area)
panel_17 = Panel(division_4)

avr = Average(Input=flatten(dim.UDimension))
panel_18 = Panel(avr)

# ---- group: Glass facade
neg_13 = Negative(Value=floor_height)
Z_6 = UnitZ(Factor=neg_13)
move_8 = Move(Geometry=end.End, Motion=Z_6)  # -> Geometry, Transform
move_9 = Move(Geometry=end_7.End, Motion=Z_6)  # -> Geometry, Transform
move_10 = Move(Geometry=end_7.Start, Motion=Z_6)  # -> Geometry, Transform
move_11 = Move(Geometry=end_3.End, Motion=Z_6)  # -> Geometry, Transform
move_12 = Move(Geometry=end_5.End, Motion=Z_6)  # -> Geometry, Transform
move_13 = Move(Geometry=end_5.Start, Motion=Z_6)  # -> Geometry, Transform
move_14 = Move(Geometry=end_3.Start, Motion=Z_6)  # -> Geometry, Transform
ln_14 = Line(StartPoint=move_8.Geometry, EndPoint=end_2.Start)
ln_15 = Line(StartPoint=move_9.Geometry, EndPoint=end_8.Start)
ln_16 = Line(StartPoint=move_11.Geometry, EndPoint=end_4.Start)
ln_17 = Line(StartPoint=move_13.Geometry, EndPoint=end_6.End)

# ----
move_15 = Move(Geometry=end.Start, Motion=Z_6)  # -> Geometry, Transform
ln_18 = Line(StartPoint=move_10.Geometry, EndPoint=end_8.End)
ln_19 = Line(StartPoint=move_14.Geometry, EndPoint=end_4.End)
ln_20 = Line(StartPoint=move_12.Geometry, EndPoint=end_6.Start)

# ---- group: Glass facade (continued)
ln_21 = Line(StartPoint=move_15.Geometry, EndPoint=end_2.End)
loft = Loft(Curves=[ln_17, ln_20], Options={Adjust=False, Closed=False, LoftEnds=0, LoftSimp=0, LoftType=0, Rebuild=10, Refit=0.01})
loft_2 = Loft(Curves=[ln_21, ln_14], Options={Adjust=False, Closed=False, LoftEnds=0, LoftSimp=0, LoftType=0, Rebuild=10, Refit=0.01})
loft_3 = Loft(Curves=[ln_19, ln_16], Options={Adjust=False, Closed=False, LoftEnds=0, LoftSimp=0, LoftType=0, Rebuild=10, Refit=0.01})
loft_4 = Loft(Curves=[ln_18, ln_15], Options={Adjust=False, Closed=False, LoftEnds=0, LoftSimp=0, LoftType=0, Rebuild=10, Refit=0.01})

# ----
glass_facade = Geometry([loft, loft_2, loft_4, loft_3])
context = Geometry([floors_slabs, glass_facade, pv_surfaces])
all_facade = ListItem(List=glass_facade, Index=list_6, Wrap=True)
brep_5 = Brep(flatten(all_facade))
one_floor_one_facade_7 = ListItem(List=brep_5, Index=_1_floor_3, Wrap=True)

dam_4 = DataDam(DataContext=context, BufferDelay=10000000, BufferMode=0)

# ---- group: Connect one geometry from here (continued)
all_facades_glass = Geometry(glass_facade)
one_whole_facade_2 = Geometry(all_facade)
one_floor_one_facade_8 = Geometry(one_floor_one_facade_7)

# ----
pv_also_glass_n_s = Geometry([loft_4, loft])
pv_also_glass_e_w = Geometry([loft_2, loft_3])
flat_e_w = Geometry([all_facades_pvs, pv_also_glass_e_w])
flat_n_s = Geometry([pv_also_glass_n_s, all_facades_pvs])

radiationanalysis = Ladybug_RadiationAnalysis(
    north=importepw.location,
    geometry=flatten(dam_3),
    context=flatten(dam_4),
    gridSize=Slider(0.5, range=0..1),
    disFromBase=0.1,
    selectedSkyMtx=flatten(selectskymtx.selectedSkyMtx),
    legendPar=flatten(legendpar),
    parallel=True,
    runIt=b_enable_simulation)  # -> readMe, contextMesh, analysisMesh, testPts, testVec, port, radiationResult, radiationMesh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; plug-in component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
mesh = Mesh(radiationanalysis.radiationMesh)
geo_7 = Geometry(radiationanalysis.radiationLegend)
area_10 = Area(Geometry=radiationanalysis.analysisMesh)  # -> Area, Centroid
ma_7 = MassAddition(Input=area_10.Area)  # -> flatten(Result), PartialResults
panel_19 = Panel(ma_7.Result)

clean_recorded_data = DataRecorder(radiationanalysis.totalRadiation, DataLimit=-10, RecordData=True)

clean_recorded_data_2 = DataRecorder(ma_7.Result, DataLimit=-10, RecordData=True)
multiplication_2 = Multiplication(A=clean_recorded_data, B=1000000)

total_radiation_kwh = Panel(multiplication_2)
division_5 = Division(A=total_radiation_kwh, B=ma_7.Result)
kwh_m2 = Panel(division_5)

panel_20 = Panel(radiationanalysis.radiationResult)
cull_i = CullIndex(List=division_5, Indices=Slider(12, range=0..100), Wrap=True)
panel_21 = Panel(clean_recorded_data_2)
panel_22 = Panel(cull_i)
division_6 = Division(A=total_radiation_kwh, B=panel_21)
panel_23 = Panel(division_6)

# ==== cluster Cluster
T = ClusterInput()
D = ClusterInput()
x = ClusterInput()
x_2 = ClusterInput()
T_2 = ClusterInput()
number_slider = Slider(16.92, range=0..100)  # disabled
number_slider_2 = Slider(17.32, range=0..100)  # disabled
number_slider_3 = Slider(12, range=0..100)  # disabled
cir = Circle(Plane=PlaneXY(0, 0, 0), Radius=number_slider)  # disabled
divide = DivideCurve(Curve=cir, Count=53, Kinks=False)  # -> Points, Tangents, Parameters; disabled
polygon = Polygon(Plane=PlaneXY(0, 0, 0), Radius=number_slider_2, Segments=number_slider_3, FilletRadius=0)  # -> Polygon, Length; disabled
ln = Line(StartPoint=divide.Points, EndPoint=divide.Points)  # disabled
move = Move(Geometry=polygon.Polygon, Motion=T)  # -> Geometry, Transform; disabled
srf = Surface(polygon.Polygon)  # disabled
offset = Offset(Curve=move.Geometry, Distance=D, Plane=PlaneXY(0, 0, 0), Corners=1)  # disabled
area = Area(Geometry=srf)  # -> Area, Centroid; disabled
neg = Negative(Value=x)  # disabled
graft = GraftTree(Tree=move.Geometry, IncludeEmptyLists=True, IncludeNullItems=True)  # disabled
panel = Panel(area.Area)  # disabled
Z = UnitZ(Factor=neg)  # disabled
neg_2 = Negative(Value=x_2)  # disabled
panel_2 = Panel(graft)  # disabled
move_2 = Move(Geometry=offset, Motion=Z)  # -> Geometry, Transform; disabled
Z_2 = UnitZ(Factor=neg_2)  # disabled
move_3 = Move(Geometry=graft, Motion=Z_2)  # -> Geometry, Transform; disabled
panel_3 = Panel(move_2.Geometry)  # disabled
pv = Loft(
    Curves=[graft, move_2.Geometry],
    Options={Adjust=False, Closed=False, LoftEnds=0, LoftSimp=0, LoftType=0, Rebuild=10, Refit=0.01})  # disabled
L = ClusterOutput(pv)
move_4 = Move(Geometry=srf, Motion=T_2)  # -> Geometry, Transform; disabled
G = ClusterOutput(move_4.Geometry)
loft = Loft(
    Curves=[move_2.Geometry, move_3.Geometry],
    Options={Adjust=False, Closed=False, LoftEnds=0, LoftSimp=0, LoftType=0, Rebuild=10, Refit=0.01})  # disabled
L_2 = ClusterOutput(loft)

# ==== cluster Cluster_2
location = ClusterInput()
month = ClusterInput()
C = ClusterInput()
G = ClusterInput()
x = ClusterInput()
C_2 = ClusterInput()
i = ClusterInput()
area = Area(Geometry=G)  # -> Area, Centroid
sunpath = Ladybug_SunPath(
    location=location,
    hour=Slider(8, range=7..19),
    day=21,
    month=month,
    timeStep=1,
    centerPt=area.Centroid,
    sunPathScale=Slider(0.001, range=0..1),
    dailyOrAnnualSunPath=True)  # -> readMe, sunVectors, sunAltitudes, sunAzimuths, port, sunSpheresMesh, sunPathCrvs, compassCrvs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; plug-in component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
panel = Panel(sunpath.sunPositions)
mesh = Mesh(sunpath.sunSpheresMesh)  # disabled
polar = ToPolar(Point=sunpath.sunVectors, System=PlaneXY(0, 0, 0))  # -> Phi, Theta, Radius; disabled
swatch = ColourSwatch(SwatchColor=RGB(89, 89, 89))  # disabled
rec = DataRecorder(polar.Phi, DataLimit=-10, RecordData=True)  # disabled
preview = CustomPreview(Geometry=sunpath.sunPathCrvs, Shader=swatch)  # disabled
panel_2 = Panel(rec)  # disabled
number_slider = Slider(10, range=0..10)  # disabled
explode = Explode(Curve=C_2, Recursive=True)  # -> Segments, Vertices; disabled
item = ListItem(List=explode.Segments, Index=i, Wrap=True)  # disabled
divide = DivideCurve(Curve=C, Count=number_slider, Kinks=True)  # -> Points, Tangents, Parameters; disabled
divide_2 = DivideCurve(Curve=item, Count=number_slider, Kinks=False)  # -> Points, Tangents, Parameters; disabled
pt = Point([divide.Points, divide_2.Points])  # disabled
number_slider_2 = Slider(0, range=0..100)  # disabled
number_slider_3 = Slider(1, range=0..1)  # disabled
subtraction = Subtraction(A=number_slider, B=1)  # disabled
subtraction_2 = Subtraction(A=number_slider, B=2)  # disabled
dom = ConstructDomain(DomainStart=1, DomainEnd=subtraction)  # disabled
item_2 = ListItem(List=pt, Index=number_slider_2, Wrap=True)  # -> flatten(Item); disabled
item_3 = ListItem(List=pt, Index=number_slider_3, Wrap=True)  # -> flatten(Item); disabled
range = Range(Domain=dom, Steps=subtraction_2)  # disabled
pt_2 = Point(item_2)  # disabled
pt_3 = Point(item_3)  # disabled
ln = Line(StartPoint=pt_2, EndPoint=pt_3)  # disabled
dist = Distance(PointA=pt_2, PointB=pt_3)  # disabled
divide_3 = DivideCurve(Curve=ln, Count=2, Kinks=False)  # -> Points, Tangents, Parameters; disabled
item_4 = ListItem(List=dist, Index=0, Wrap=True)  # disabled
item_5 = ListItem(List=divide_3.Points, Index=1, Wrap=True)  # disabled
Y = UnitY(Factor=item_4)  # disabled
panel_3 = Panel(item_5)  # disabled
neg = Negative(Value=x)  # disabled
rotate = Rotate(Geometry=ln, Angle=polar.Phi, Plane=item_5)  # -> Geometry, Transform; disabled
multiplication = Multiplication(A=range, B=Y)  # -> graft(Result); disabled
X = UnitX(Factor=neg)  # disabled
move = Move(Geometry=rotate.Geometry, Motion=multiplication)  # -> Geometry, Transform; disabled
number_slider_4 = Slider(1, range=0..10)  # disabled
loft = Loft(
    Curves=[move.Geometry, rotate.Geometry],
    Options={Adjust=False, Closed=False, LoftEnds=0, LoftSimp=0, LoftType=0, Rebuild=10, Refit=0.01})  # disabled
move_2 = Move(Geometry=loft, Motion=X)  # -> Geometry, Transform; disabled
mirror = Mirror(Geometry=move_2.Geometry, Plane=PlaneYZ(0, 0, 0))  # -> Geometry, Transform; disabled
neg_2 = Negative(Value=number_slider_4)  # disabled
offset = Offset(Surface=mirror.Geometry, Distance=neg_2, Retrim=True)  # disabled
flip = Flip(Surface=offset)  # -> Surface, Result; disabled
offset_2 = Offset(Surface=loft, Distance=number_slider_4, Retrim=True)  # disabled
tracking_pv = Geometry([offset_2, flip.Surface])
