# Grasshopper definition Simplified solar radiation simulation.gh (Grasshopper 0.9.76)
# plug-ins: Python Interpreter

ladybug = Ladybug_Ladybug()  # -> Vviiiiiiiiiizzz; plug-in component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
open_weather_file = Ladybug_OpenEPWWeatherFile(open=Toggle(True))  # -> epwFile; plug-in component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

# ----
# 4. Simulate the
# whole year
toggle = BooleanToggle(True)

# ---- group: Automatic image saving
# 3. Setup image saving
# Connect the file name
# on the slider you have
# for the analysis period
# (year, month, day or HOY)
panel = Panel("<<folder path here>>")
toggle_2 = BooleanToggle(True)
captureview = Ladybug_CaptureView(
    folder=panel,
    imageWidth=Slider(6500, range=0..10000),
    keepAspectR=toggle_2,
    transparBack=toggle_2,
    capture=Toggle(False))  # -> imagePath; plug-in component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

# ---- group: Year
legendpar = Ladybug_LegendParameters(lowBound="0", highBound="45.6", legendScale=Slider(0.2, range=0..10), fontSize=Slider(1.5, range=0..10))  # -> legendPar; plug-in component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

# ---- group: 1 panel - Mitsubishi Electric PV-MLU255HC 255Wp
rec_2pt = Rectangle2Pt(Plane=PlaneXY(0, 0, 0), PointA="0,0", PointB="1.625,1.019", Radius=0)  # -> Rectangle, Length

# ---- group: Montly
legendpar_2 = Ladybug_LegendParameters(lowBound="0", highBound="45.6", legendScale=Slider(0.2, range=0..10), fontSize=Slider(1.5, range=0..10))  # -> legendPar; plug-in component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

# ---- group: Daily analysis period
number_slider = Slider(23, range=1..31)
hour = Slider(12, range=1..23)
month = Slider(6, range=1..12)
addition = Addition(A=hour, B=1)
analysisperiod = Ladybug_AnalysisPeriod(fromMonth=month, fromDay=number_slider, fromHour=hour, toMonth=month, toDay=number_slider, toHour=addition)  # -> readMe, analysisPeriod; plug-in component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

# ---- group: Montlhy analysis period
day = Slider(31, range=1..31)
hour_2 = Slider(24, range=1..24)
month_2 = Slider(7, range=7..12)
day_2 = Slider(1, range=1..31)
hour_3 = Slider(1, range=1..24)
analysisperiod_2 = Ladybug_AnalysisPeriod(fromMonth=month_2, fromDay=day_2, fromHour=hour_3, toMonth=month_2, toDay=day, toHour=hour_2)  # -> readMe, analysisPeriod; plug-in component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

# ----
# 6. Simulate specific
# hour, day or
# month of specific
# times of the year
montly = BooleanToggle(False)
daily = BooleanToggle(False)
fly = Ladybug_fly(inputSliders=month_2, fly=montly)  # -> Vviiiiiiiiiizzz; plug-in component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
fly_2 = Ladybug_fly(inputSliders=number_slider, fly=daily)  # -> Vviiiiiiiiiizzz; plug-in component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

# ---- group: If use surface check surface normal
srf = Surface(rec_2pt.Rectangle)

# ----
# Small scale PV system:
# 
# 40 panels - 10.2 kWp
# 45 degrees, south
panel_2 = Panel("8")
arrrec = RectangularArray(Geometry=srf, Cell=rec_2pt.Rectangle, XCount=panel_2, YCount="5")  # -> Geometry, Transform
rad = Radians(Degrees="0")
rotax = RotateAxis(Geometry=arrrec.Geometry, Angle=rad, Axis=Line((0, 0, 0), (10, 0, 0)))  # -> flatten(Geometry), Transform
area = Area(Geometry=rotax.Geometry)  # -> Area, Centroid
ma = MassAddition(Input=area.Area)  # -> Result, PartialResults
pv_area_m2 = Panel(ma.Result)

# ----
# 1. Generate sky
# 2. Select which
# legend parameter
toggle_3 = BooleanToggle(True)
gencumulativeskymtx = Ladybug_GenCumulativeSkyMtx(epwFile=open_weather_file, skyDensity=0, useOldRes=True, runIt=toggle_3)  # -> readMe, cumulativeSkyMtx; plug-in component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
selectskymtx = Ladybug_selectSkyMtx(cumulativeSkyMtx=gencumulativeskymtx.cumulativeSkyMtx, removeDiffuse=False, removeDirect=False)  # -> readMe, selectedSkyMtx; plug-in component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
radiationanalysis = Ladybug_RadiationAnalysis(
    geometry=flatten(rotax.Geometry),
    gridSize=Slider(0.1, range=0..0.1),
    disFromBase="0.01",
    selectedSkyMtx=flatten(selectskymtx.selectedSkyMtx),
    parallel=Toggle(True),
    runIt=toggle)  # -> readMe, contextMesh, analysisMesh, testPts, testVec, port, radiationResult, radiationMesh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; plug-in component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
panel_3 = Panel(radiationanalysis.radiationResult)
area_2 = Area(Geometry=radiationanalysis.analysisMesh)  # -> Area, Centroid
ma_2 = MassAddition(Input=area_2.Area)  # -> Result, PartialResults
division = Division(A=radiationanalysis.totalRadiation, B=ma_2.Result)
panel_4 = Panel(radiationanalysis.totalRadiation)
panel_5 = Panel(division)

if_you_are_using_modified_epw_check_if_l = Panel(gencumulativeskymtx.readMe)  # "If you are using modified epw check if LB is getting the correct skymatrix here"

# ----
# 5. Simulate for each
# hour of the year
# 
# 
# or
hoy = Slider(0, range=0..8760)
selectskymtx_2 = Ladybug_selectSkyMtx(cumulativeSkyMtx=gencumulativeskymtx.cumulativeSkyMtx, HOY=hoy, removeDiffuse=False, removeDirect=False)  # -> readMe, selectedSkyMtx; plug-in component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
rtradiationanalysis = Ladybug_RealTimeRadiationAnalysis(selectedSkyMatrix=selectskymtx_2.selectedSkyMtx, intersectionMatrix=radiationanalysis.intersectionMtx)  # -> radiationResult; plug-in component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
ma_3 = MassAddition(Input=rtradiationanalysis)  # -> Result, PartialResults
fly_3 = Ladybug_fly(inputSliders=hoy, fly=Toggle(False))  # -> Vviiiiiiiiiizzz; plug-in component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
rec = DataRecorder(ma_3.Result, DataLimit=-10, RecordData=True)
panel_6 = Panel(rec)

# ---- group: Daily
legendpar_3 = Ladybug_LegendParameters(lowBound="0", highBound="3.77", legendScale=Slider(0.2, range=0..10), fontSize=Slider(1.5, range=0..10))  # -> legendPar; plug-in component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

# ----
viewer = ParamViewer(rotax.Geometry)

# ---- group: Hourly
legendpar_4 = Ladybug_LegendParameters(lowBound="0", highBound=".5", legendScale=Slider(0.2, range=0..10), fontSize=Slider(1.5, range=0..10))  # -> legendPar; plug-in component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

# ---- group: Check direction of surface normal
evalsrf = EvaluateSurface(Surface=reparameterize(rotax.Geometry), Point="0.5,0.5")  # -> Point, Normal, Frame
multiplication = Multiplication(A=evalsrf.Normal, B=Slider(0.39, range=0..1))
vdis = VectorDisplay(Anchor=evalsrf.Point, Vector=expr("x*10", multiplication))
