# Grasshopper definition FoldingStructures.gh (Grasshopper 0.9.76)
# plug-ins: Grasshopper-ARCHICAD Live Connection 1.8

# ---- group: Set two points to make the structure
pt = Point(Point(1.4950262, 0.4756901547, 0))
pt_2 = Point(Point(49.36002168, 3.464344966, 0))

# ---- group: y max
pdecon = Deconstruct(Point=pt)  # -> XComponent, YComponent, ZComponent
panel = Panel(pdecon.YComponent)

# ----
number_slider = Slider(30.95, range=0..30.95)
number_slider_2 = Slider(0.5, range=0..1)
pdecon_2 = Deconstruct(Point=pt_2)  # -> XComponent, YComponent, ZComponent
panel_2 = Panel(pdecon.XComponent)
panel_3 = Panel(pdecon_2.XComponent)
subtraction = Subtraction(A=panel_2, B=panel_3)
panel_4 = Panel(pdecon_2.YComponent)
subtraction_2 = Subtraction(A=panel, B=pdecon_2.YComponent)
addition = Addition(A=panel_4, B=number_slider)
subtraction_3 = Subtraction(A=panel_3, B=Slider(12, range=0..100))
panel_5 = Panel(subtraction_2)
panel_6 = Panel(subtraction)
addition_2 = Addition(A=addition, B=number_slider_2)
addition_3 = Addition(A=pdecon_2.ZComponent, B=Slider(4, range=0..10))
addition_4 = Addition(A=pdecon_2.YComponent, B=number_slider_2)
division = Division(A=panel_6, B=panel_5)
multiplication = Multiplication(A=number_slider, B=division)
addition_5 = Addition(A=addition, B=division)
addition_6 = Addition(A=pdecon_2.XComponent, B=multiplication)
addition_7 = Addition(A=subtraction_3, B=multiplication)
slope = Panel(division)
pt_3 = ConstructPoint(XCoordinate=subtraction_3, YCoordinate=addition_4, ZCoordinate=addition_3)
Z = UnitZ(Factor=Slider(5, range=0..100))
X = UnitX(Factor=Slider(17, range=0..100))
panel_7 = Panel(multiplication)
pt_4 = ConstructPoint(XCoordinate=addition_6, YCoordinate=addition_5, ZCoordinate=pdecon_2.ZComponent)
pt_5 = ConstructPoint(XCoordinate=addition_7, YCoordinate=addition_2, ZCoordinate=addition_3)
number_slider_3 = Slider(4, range=0..10)
bzspan = BezierSpan(StartPoint=pt_2, StartTangent=Z, EndPoint=pt_3, EndTangent=X)  # -> Curve, Length, Domain
bzspan_2 = BezierSpan(StartPoint=pt_4, StartTangent=Z, EndPoint=pt_5, EndTangent=X)  # -> Curve, Length, Domain
divide = DivideCurve(Curve=bzspan_2.Curve, Count=number_slider_3, Kinks=False)  # -> Points, Tangents, Parameters
divide_2 = DivideCurve(Curve=bzspan.Curve, Count=number_slider_3, Kinks=False)  # -> Points, Tangents, Parameters
pt_6 = Point(divide_2.Points)
pt_7 = Point(divide.Points)
intcrv = Interpolate(Vertices=pt_6, Degree=3, Periodic=False, KnotStyle=1)  # -> Curve, Length, Domain
intcrv_2 = Interpolate(Vertices=pt_7, Degree=3, Periodic=False, KnotStyle=1)  # -> Curve, Length, Domain

edgesrf = EdgeSurface(CurveA=intcrv.Curve, CurveB=intcrv_2.Curve)
f_x = F1(Function="X*4", X=Slider(4, range=0..11))
panel_8 = Panel("""TRUE
FALSE""")
panel_9 = Panel("""TRUE
FALSE""")
bool = Boolean(panel_8)
bool_2 = Boolean(panel_9)
num = Number(bool)
num_2 = Number(bool_2)
f_x_2 = F1(Function="ABS(X-1)", X=num)
f_x_3 = F1(Function="ABS(X-1)", X=num_2)
bool_3 = Boolean(f_x_2)
bool_4 = Boolean(f_x_3)

# ---- group: Inside Grid
range = Range(Domain=Domain(0, 1), Steps=f_x)
graph = GraphMapper(
    range,
    x0=0,
    x1=1,
    y0=0,
    y1=1,
    A=1,
    B=0,
    container_name="Linear",
    Graph_x0=0.25,
    Graph_x1=0.75,
    Graph_y0=0.25,
    Graph_y1=0.75)
crv = Curve(reparameterize(intcrv_2.Curve))
eval = EvaluateCurve(Curve=crv, Parameter=graph)  # -> Point, Tangent, Length
srf_cp = SurfaceCP(Point=eval.Point, Surface=edgesrf)  # -> Point, UVPoint, Distance
iso = IsoCurve(Surface=edgesrf, UVPoint=srf_cp.UVPoint)  # -> UIsocurve, VIsocurve
crv_2 = Curve(reparameterize(iso.UIsocurve))
eval_2 = EvaluateCurve(Curve=graft(crv_2), Parameter=graph)  # -> Point, Tangent, Length

# ---- group: Offset grid
offset = Offset(Surface=edgesrf, Distance=Slider(1, range=0..100), Retrim=True)
wires = BrepWireframe(Brep=offset, Density=-1)
item = ListItem(List=wires, Index=Slider(1, range=0..3), Wrap=False)
crv_3 = Curve(reparameterize(item))
eval_3 = EvaluateCurve(Curve=crv_3, Parameter=graph)  # -> Point, Tangent, Length
srf_cp_2 = SurfaceCP(Point=eval_3.Point, Surface=offset)  # -> Point, UVPoint, Distance
iso_2 = IsoCurve(Surface=offset, UVPoint=srf_cp_2.UVPoint)  # -> UIsocurve, VIsocurve
crv_4 = Curve(reparameterize(iso_2.UIsocurve))
eval_4 = EvaluateCurve(Curve=graft(crv_4), Parameter=graph)  # -> Point, Tangent, Length

# ---- group: Label
pt_8 = Point(eval_4.Point)
lng = ListLength(List=pt_8)
series = Series(Start=0, Step=1, Count=lng)
tag = TextTag3D(Location=pt_8, Text=series, Size=1)

# ----
simplify = SimplifyTree(Tree=eval_2.Point, Front=False)
simplify_2 = SimplifyTree(Tree=eval_4.Point, Front=False)

series_2 = Series(Start=1, Step=2, Count=expr("x/2", f_x))
int = Integer(series_2)
concat = Concatenate(Start="{", End=int)
concat_2 = Concatenate(Start=concat, End="}")
branch = TreeBranch(Tree=simplify_2, Path=concat_2, MaintainPaths=False)

series_3 = Series(Start=1, Step=2, Count=expr("x/2", f_x))
int_2 = Integer(series_3)
concat_3 = Concatenate(Start="{", End=int_2)
concat_4 = Concatenate(Start=concat_3, End="}")
branch_2 = TreeBranch(Tree=simplify, Path=concat_4, MaintainPaths=False)

series_4 = Series(Start=0, Step=2, Count=expr("x/2", f_x))
int_3 = Integer(series_4)
concat_5 = Concatenate(Start="{", End=int_3)
concat_6 = Concatenate(Start=concat_5, End="}")
branch_3 = TreeBranch(Tree=simplify_2, Path=concat_6, MaintainPaths=False)

series_5 = Series(Start=0, Step=2, Count=expr("x/2", f_x))
int_4 = Integer(series_5)
concat_7 = Concatenate(Start="{", End=int_4)
concat_8 = Concatenate(Start=concat_7, End="}")
branch_4 = TreeBranch(Tree=simplify, Path=concat_8, MaintainPaths=False)

cull = CullPattern(List=branch_2, CullPattern=bool_4)
cull_2 = CullPattern(List=branch_3, CullPattern=bool_3)
cull_3 = CullPattern(List=branch_4, CullPattern=bool)
cull_4 = CullPattern(List=branch, CullPattern=bool_2)
weave = Weave(Pattern=[0, 1], Stream0=cull_3, Stream1=cull_2, NullGaps=False)
weave_2 = Weave(Pattern=[0, 1], Stream0=cull_4, Stream1=cull, NullGaps=False)
pline = PolyLine(Vertices=weave, Closed=False)
pline_2 = PolyLine(Vertices=weave_2, Closed=False)
crv_5 = Curve(flatten(pline))
crv_6 = Curve(flatten(pline_2))
weave_3 = Weave(Pattern=[0, 1], Stream0=crv_5, Stream1=crv_6, NullGaps=False)
end = EndPoints(Curve=weave_3)  # -> Start, End
crv_7 = Curve(weave_3)
explode = Explode(Curve=crv_7, Recursive=True)  # -> Segments, Vertices
pt_9 = Point(explode.Vertices)
panel_10 = Panel(explode.Segments)

# ---- group: Label
pt_10 = Point(explode.Vertices)
lng_2 = ListLength(List=pt_10)
series_6 = Series(Start=0, Step=1, Count=lng_2)

# ----
tag_2 = TextTag(Location=pt_10, Text=series_6)

flatten = FlattenTree(Data=pt_9, Path="{0}")
int_5 = Integer(flatten(f_x))
panel_11 = Panel(int_5)
int_6 = Integer(flatten(f_x))
series_7 = Series(Start=expr("x*2+2", int_5), Step=expr("x*2+2", int_5), Count=expr("x/2", int_6))
series_8 = Series(Start=expr("x*2+3", int_5), Step=expr("x*2+2", int_5), Count=expr("x/2", int_6))
series_9 = Series(Start=expr("x+1", int_5), Step=expr("x*2+2", int_5), Count=expr("x/2", int_6))
series_10 = Series(Start=expr("x*2+3", int_5), Step=expr("x*2+2", int_5), Count=expr("x/2", int_6))
panel_12 = Panel(int_6)
series_11 = Series(Start=expr("x+2", int_5), Step=expr("x*2+2", int_5), Count=expr("x/2", int_6))
series_12 = Series(Start=expr("x*2+3", int_5), Step=expr("x*2+2", int_5), Count=expr("x/2", int_6))
series_13 = Series(Start=expr("x+3", int_5), Step=expr("x*2+2", int_5), Count=expr("x/2", int_6))
series_14 = Series(Start=expr("x*2+4", int_5), Step=expr("x*2+2", int_5), Count=expr("x/2", int_6))
series_15 = Series(Start=expr("x*2+3", int_5), Step=expr("x*2+2", int_5), Count=expr("x/2", int_6))
series_16 = Series(Start=expr("x+3", int_5), Step=expr("x*2+2", int_5), Count=expr("x/2", int_6))

series_17 = Series(Start=1, Step=expr("x*2+2", int_5), Count=expr("x/2", int_6))
series_18 = Series(Start=1, Step=expr("x*2+2", int_5), Count=expr("x/2", int_6))
series_19 = Series(Start=0, Step=expr("x*2+2", int_5), Count=expr("x/2", int_6))
series_20 = Series(Start=expr("x+2", int_5), Step=expr("x*2+2", int_5), Count=expr("x/2", int_6))
series_21 = Series(Start=expr("x+1", int_5), Step=expr("x*2+2", int_5), Count=expr("x/2", int_6))
series_22 = Series(Start=expr("x+1", int_5), Step=expr("x*2+2", int_5), Count=expr("x/2", int_6))
series_23 = Series(Start=expr("x+2", int_5), Step=expr("x*2+2", int_5), Count=expr("x/2", int_6))
series_24 = Series(Start=1, Step=expr("x*2+2", int_5), Count=expr("x/2", int_6))
series_25 = Series(Start=expr("x+3", int_5), Step=expr("x*2+2", int_5), Count=expr("x/2", int_6))
series_26 = Series(Start=expr("x+3", int_5), Step=expr("x*2+2", int_5), Count=expr("x/2", int_6))
series_27 = Series(Start=2, Step=expr("x*2+2", int_5), Count=expr("x/2", int_6))
series_28 = Series(Start=1, Step=expr("x*2+2", int_5), Count=expr("x/2", int_6))

series_29 = Series(Start=series_19, Step=2, Count=expr("x/2", int_5))
series_30 = Series(Start=series_17, Step=2, Count=expr("x/2", int_5))
series_31 = Series(Start=series_22, Step=2, Count=expr("x/2", int_5))
item_2 = ListItem(List=flatten, Index=series_29, Wrap=False)
item_3 = ListItem(List=flatten, Index=series_30, Wrap=False)
item_4 = ListItem(List=flatten, Index=series_31, Wrap=False)
srf4pt = _4PointSurface(CornerA=item_2, CornerB=item_3, CornerC=item_4)

series_32 = Series(Start=series_18, Step=2, Count=expr("x/2", int_5))
series_33 = Series(Start=series_20, Step=2, Count=expr("x/2", int_5))
series_34 = Series(Start=series_21, Step=2, Count=expr("x/2", int_5))
item_5 = ListItem(List=flatten, Index=series_32, Wrap=False)
item_6 = ListItem(List=flatten, Index=series_33, Wrap=False)
item_7 = ListItem(List=flatten, Index=series_34, Wrap=False)
srf4pt_2 = _4PointSurface(CornerA=item_5, CornerB=item_6, CornerC=item_7)

series_35 = Series(Start=series_24, Step=2, Count=expr("x/2", int_5))
series_36 = Series(Start=series_25, Step=2, Count=expr("x/2", int_5))
series_37 = Series(Start=series_23, Step=2, Count=expr("x/2", int_5))
item_8 = ListItem(List=flatten, Index=series_35, Wrap=False)
item_9 = ListItem(List=flatten, Index=series_36, Wrap=False)
item_10 = ListItem(List=flatten, Index=series_37, Wrap=False)
srf4pt_3 = _4PointSurface(CornerA=item_8, CornerB=item_10, CornerC=item_9)

series_38 = Series(Start=series_28, Step=2, Count=expr("x/2", int_5))
series_39 = Series(Start=series_27, Step=2, Count=expr("x/2", int_5))
series_40 = Series(Start=series_26, Step=2, Count=expr("x/2", int_5))
item_11 = ListItem(List=flatten, Index=series_38, Wrap=False)
item_12 = ListItem(List=flatten, Index=series_39, Wrap=False)
item_13 = ListItem(List=flatten, Index=series_40, Wrap=False)
srf4pt_4 = _4PointSurface(CornerA=item_11, CornerB=item_12, CornerC=item_13)

series_41 = Series(Start=expr("x+2", int_5), Step=expr("x*2+2", int_5), Count=expr("x/2", int_6))
series_42 = Series(Start=expr("x+1", int_5), Step=expr("x*2+2", int_5), Count=expr("x/2", int_6))

series_43 = Series(Start=series_42, Step=2, Count=expr("x/2", int_5))
series_44 = Series(Start=series_8, Step=2, Count=expr("x/2", int_5))
series_45 = Series(Start=series_7, Step=2, Count=expr("x/2", int_5))
item_14 = ListItem(List=flatten, Index=series_43, Wrap=False)
item_15 = ListItem(List=flatten, Index=series_45, Wrap=False)
item_16 = ListItem(List=flatten, Index=series_44, Wrap=False)
srf4pt_5 = _4PointSurface(CornerA=item_14, CornerB=item_16, CornerC=item_15)

series_46 = Series(Start=series_9, Step=2, Count=expr("x/2", int_5))
series_47 = Series(Start=series_41, Step=2, Count=expr("x/2", int_5))
series_48 = Series(Start=series_10, Step=2, Count=expr("x/2", int_5))
item_17 = ListItem(List=flatten, Index=series_46, Wrap=False)
item_18 = ListItem(List=flatten, Index=series_47, Wrap=False)
item_19 = ListItem(List=flatten, Index=series_48, Wrap=False)
srf4pt_6 = _4PointSurface(CornerA=item_17, CornerB=item_18, CornerC=item_19)

series_49 = Series(Start=series_16, Step=2, Count=expr("x/2", int_5))
series_50 = Series(Start=series_14, Step=2, Count=expr("x/2", int_5))
series_51 = Series(Start=series_12, Step=2, Count=expr("x/2", int_5))
item_20 = ListItem(List=flatten, Index=series_49, Wrap=False)
item_21 = ListItem(List=flatten, Index=series_51, Wrap=False)
item_22 = ListItem(List=flatten, Index=series_50, Wrap=False)
srf4pt_7 = _4PointSurface(CornerA=item_20, CornerB=item_21, CornerC=item_22)

series_52 = Series(Start=series_11, Step=2, Count=expr("x/2", int_5))
series_53 = Series(Start=series_13, Step=2, Count=expr("x/2", int_5))
series_54 = Series(Start=series_15, Step=2, Count=expr("x/2", int_5))
item_23 = ListItem(List=flatten, Index=series_52, Wrap=False)
item_24 = ListItem(List=flatten, Index=series_53, Wrap=False)
item_25 = ListItem(List=flatten, Index=series_54, Wrap=False)
srf4pt_8 = _4PointSurface(CornerA=item_23, CornerB=item_24, CornerC=item_25)

srf = Surface(flatten([srf4pt, srf4pt_2, srf4pt_4, srf4pt_3, srf4pt_5, srf4pt_8, srf4pt_7, srf4pt_6]))

# ---- group: Archicad connection
srf_2 = Surface(srf)
edges = BrepEdges(Brep=srf_2)  # -> Naked, Interior, NonManifold
panel_13 = Panel(srf_2)
number_slider_4 = Slider(0.05, range=0..0.1)
area = Area(Geometry=srf_2)  # -> Area, Centroid
pframes = PerpFrames(Curve=edges.Naked, Count=10, Align=True)  # -> Frames, Parameters
offset_2 = Offset(Curve=edges.Naked, Distance=0.1, Plane=PlaneXY(0, 0, 0), Corners=4)
rectangle = Rectangle(Plane=pframes.Frames, XSize=number_slider_4, YSize=number_slider_4, Radius=0)  # -> Rectangle, Length
panel_14 = Panel(area.Area)
layer = Layer(AC_Layer=(2, 0, -1))
buildmat = BuildingMaterial(AC_BuildingMaterial=(2, 0, -1))
layer_2 = Layer(AC_Layer=(2, 0, -1))
loft = Loft(
    Curves=rectangle.Rectangle,
    Options={Adjust=False, Closed=False, LoftEnds=0, LoftSimp=0, LoftType=0, Rebuild=10, Refit=0.01})
buildmat_2 = BuildingMaterial(AC_BuildingMaterial=(2, 0, -1))
brep = Brep(loft)
morphset = MorphSettings(BuildingMaterial=buildmat, Layer=layer_2, StructuralFunction=1, Position=0, RenovationStatus=2)
morphset_2 = MorphSettings(BuildingMaterial=buildmat_2, Layer=layer, RenovationStatus=Slider(2, range=0..10))
morphc = MorphCurve(Synchronize=Toggle(False), Curve=srf_2, MorphSettings=morphset)
morphc_2 = MorphCurve(Synchronize=Toggle(False), Curve=brep, MorphSettings=morphset_2)
