# Grasshopper definition Extraterrestrial Radiation builder.gh (Grasshopper 0.9.76)
# plug-ins: Python Interpreter

ladybug = Ladybug_Ladybug()  # -> Vviiiiiiiiiizzz; plug-in component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

# ----
# Variables
# documentation
toggle = BooleanToggle(True)
# Variables description: Io = Hourly Extraterrestrial Radiation
# Isc = Solar constant (1367W/m2)
# Eo = eccentricity correction factor
# Lat  = latitude of location
# Dec = declination angle (in degrees)
# w = hour angle
# n = number of the julian day
# AST = local solar time
# d = day angle
# ET (min) = equation of time
# LST° = local standart time
# Ls° = standard meridian for a local zone (if west positive and east negative)
# L° = longitude of the location (if west positive and east negative)
# Z = zenith angle (must be between zero and 90 degrees)
# Ys = solar azimuth angle
# a = solar altitude angle
# 
# ***all cosine and sine takes values in rad
open_weather_file = Ladybug_OpenEPWWeatherFile(open=toggle)  # -> epwFile; plug-in component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
importepw = Ladybug_ImportEpw(epwFile=open_weather_file)  # -> readMe, latitude, location, dryBulbTemperature, dewPointTemperature, relativeHumidity, windSpeed, windDirection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; plug-in component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

# ----
# Hour of
# the day
num = Number([0, 1, 2, 3, 4, 5, 6, 7, 8, 9, 10, 11, 12, 13, 14, 15, 16, 17, 18, 19, 20, 21, 22, 23])
panel = Panel(num)
lst = Number(panel)

# ---- group: Run simulation / Reset Data Recorders
# 1. reset data
# recorders
# 2. Run simulation
button = Button()
c_script = CSharpScript(resetToggle=button)  # inputs resetToggle: Boolean
# ---------- c_script: C# ----------
    if(resetToggle)
    {
      //going through all the objects of the grashopper document;
      foreach (object obj in GrasshopperDocument.Objects)
      {
        ///cheking only for the GH_DataRecorder T components
        if (obj is Grasshopper.Kernel.Special.GH_DataRecorder)
        {
          ///cast the T object into GH_DataRecorder
          Grasshopper.Kernel.Special.GH_DataRecorder dataDestroy = (Grasshopper.Kernel.Special.GH_DataRecorder) obj;

          ///used the nesesary methods to destroy the data and reset the rec component
          dataDestroy.DestroyRecordedData();
          dataDestroy.ExpireSolution(true);

        }
      }
    }
# ---------- end c_script ----------

# ----
# Location
# characteristics
explodelocation = Ladybug_DecomposeLocation(location=importepw.location)  # -> locationName, latitude, longitude, timeZone, elevation; plug-in component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
panel_2 = Panel(explodelocation.locationName)
expression = Expression(x=explodelocation.longitude, Expression="x*(-1)")
expression_2 = Expression(y=explodelocation.timeZone, Expression="y*(-1)")
multiplication = Multiplication(_15=15, B=expression_2)

# ---- group: Run simulation / Double click to true
toggle_2 = BooleanToggle(False)

# ---- group: This one there is no loop
# Day of
# the year
day_of_the_year = Slider(365, range=0..365)
fly = Ladybug_fly(inputSliders=day_of_the_year, fly=toggle_2)  # -> Vviiiiiiiiiizzz; plug-in component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
doy = Number(day_of_the_year)
rec = DataRecorder(doy, DataLimit=-10, RecordData=True)
panel_3 = Panel(rec)

# ---- group: Extraterrestrial on a horizontal plane
# Equation
# of Time
day_angle = Expression(n=doy, Expression="360*(n-1)/365")
multiplication_2 = Multiplication(A=day_angle, B="2")
rad = Radians(Degrees=day_angle)
rad_2 = Radians(Degrees=multiplication_2)
cos = Cosine(Value=rad_2)
sin = Sine(Value=rad_2)
sin_2 = Sine(Value=rad)
cos_2 = Cosine(Value=rad)
equation_of_time = Expression(
    sin2d=sin,
    cos2d=cos,
    sind=sin_2,
    cosd=cos_2,
    Expression="229.2*(0.000075 + 0.001868*cosd - 0.032077*sind - 0.014615*cos2d - 0.04089*sin2d)")
panel_4 = Panel(equation_of_time)

# Hour angle
# Eccentricity
# correction
# factor
expression_3 = Expression(n=doy, Expression="2*π*n/365")
cos_3 = Cosine(Value=expression_3)
eccentricity_correction_factor_eo = Expression(y=cos_3, Expression="1+0.033*y")

# Solar
# constant
solar_constant = ValueList({"1367 W/m2": 1367, "1353 W/m2": 1353, "1366.1 W/m2": 1366.1}, selected="1367 W/m2")

# Solar
# declination
solar_declination = Expression(n=doy, Expression="(2*π*(284+n))/365")
sin_3 = Sine(Value=solar_declination)
solar_declination_2 = Expression(x=sin_3, Expression="23.45*x")

# ----
rec_2 = DataRecorder(eccentricity_correction_factor_eo, DataLimit=-10, RecordData=True)

# ---- group: Extraterrestrial on a horizontal plane
# Solar time
solar_time = Expression(LST=lst, ET=panel_4, Ls=multiplication, L=expression, Expression=" LST + (ET/60)  + ((Ls - L)*4)/60")
panel_5 = Panel(solar_time)

# ---- group: Extraterrestrial on a horizontal plane / Hour Angle
hour_angle_w = Expression(AST=panel_5, Expression="15*(AST-12)")

# ---- group: Extraterrestrial on a horizontal plane
# Cosine
# of zenith
dec = Panel(solar_declination_2)
lat = Panel(explodelocation.latitude)
w = Panel(hour_angle_w)
rad_3 = Radians(Degrees=w)
rad_4 = Radians(Degrees=lat)
rad_5 = Radians(Degrees=dec)
cosw = Cosine(Value=rad_3)
sindec = Sine(Value=rad_5)
coslat = Cosine(Value=rad_4)
cosdec = Cosine(Value=rad_5)
sinlat = Sine(Value=rad_4)
expression_4 = Expression(
    sinLat=sinlat,
    sinDec=sindec,
    cosLat=coslat,
    cosDec=cosdec,
    cosw=cosw,
    Expression="(sinLat*sinDec) + (cosLat*cosw*cosDec)")
rec_3 = DataRecorder(expression_4, DataLimit=-10, RecordData=True)
panel_6 = Panel(rec_3)

# Extraterrestrial radiation
# on an horizontal surface
panel_7 = Panel(solar_constant)
extraterrestrial_solar_radiation_io = Expression(Isc=panel_7, Eo=eccentricity_correction_factor_eo, cosZ=expression_4, Expression="Isc*Eo*cosZ")
rec_4 = DataRecorder(extraterrestrial_solar_radiation_io, DataLimit=-10, RecordData=True)
panel_8 = Panel(rec_4)

# Extraterrestrial radiation
# on an horizontal surface
# 
# results for each hour
num_2 = Number(panel_8)
expression_5 = Expression(x=num_2, Expression="If(x ≤ 0, 0, x)")
panel_9 = Panel(expression_5)
graph = QuickGraph(panel_9)

# ---- group: Deriving direct and diffuse
ghi_ideal = Number(expression_5)
cosz = Number(rec_3)

# Diffuse solar radiation
# (ideal - kt > 0.75)
for_kt_0_75_clear_sky_then = Expression(GHI=ghi_ideal, Expression="0.177*GHI")
panel_10 = Panel(for_kt_0_75_clear_sky_then)

# Direct solar radiation
dhi = Expression(GHI=ghi_ideal, dHI=for_kt_0_75_clear_sky_then, cosZ=cosz, Expression="(GHI - dHI)/cosZ")
panel_11 = Panel(dhi)

# ---- group: Deriving direct and diffuse / Checking if number corresponds to original GHI
expression_6 = Expression(dHI=for_kt_0_75_clear_sky_then, DNI=dhi, cosZ=cosz, Expression="dHI + (DNI*cosZ)")
panel_12 = Panel(expression_6)
panel_13 = Panel(ghi_ideal)

# ---- group: Only in a case of a tilted surface
# Surface
# slope
# (not being used)
b_in_degrees = Panel("0")

# Solar altitude
# angle (a)
# (not being used)
# Connect solar declination (Dec) here -->
subtraction = Subtraction(Lat=explodelocation.latitude)
abs = Absolute(Value=subtraction)
solar_altitude_angle = Expression(x=abs, Expression="90 - x")

# Connect solar declination (Dec) in degrees here -->
# Cosine
# of angle of incidence (Teta)(O)
# (not being used)
# Connect latitude (Lat) in degrees here -->
# Connect hour angle (w) in degrees here -->
dec_2 = Panel()
lat_2 = Panel()
w_2 = Panel()
rad_6 = Radians(Degrees=b_in_degrees)
rad_7 = Radians(Degrees=w_2)
rad_8 = Radians(Degrees=lat_2)
rad_9 = Radians(Degrees=dec_2)
cosb = Cosine(Value=rad_6)
sinb = Sine(Value=rad_6)
cosw_2 = Cosine(Value=rad_7)
sinw = Sine(Value=rad_7)
sindec_2 = Sine(Value=rad_9)
coslat_2 = Cosine(Value=rad_8)
cosdec_2 = Cosine(Value=rad_9)
sinlat_2 = Sine(Value=rad_8)

# Solar azimuth
# angle (Ys)
# (not being used)
rad_10 = Radians(Degrees=solar_altitude_angle)
cosa = Cosine(Value=rad_10)
expression_7 = Expression(cosDec=cosdec_2, sinw=sinw, cosa=cosa, Expression="(cosDec*sinw)/cosa")
asin = ArcSine(Value=expression_7)
cos_4 = Cosine(Value=asin)

expression_8 = Expression(
    sinLat=sinlat_2,
    sinDec=sindec_2,
    cosLat=coslat_2,
    cosDec=cosdec_2,
    cosw=cosw_2,
    sinw=sinw,
    cosB=cosb,
    sinB=sinb,
    cosY=cos_4,
    sinY=expression_7,
    Expression="(sinLat*sinDec*cosB) - (sinDec*cosLat*sinB*cosY) + (cosDec*cosLat*cosB*cosw) + (cosDec*sinLat*sinB*cosw*cosY) + (cosDec*sinB*sinw*sinY)")
rec_5 = DataRecorder(expression_8, DataLimit=-10, RecordData=True)
