# Grasshopper definition Ineichen simplified clear sky builder.gh (Grasshopper 0.9.76)
# plug-ins: Python Interpreter

ladybug = Ladybug_Ladybug()  # -> Vviiiiiiiiiizzz; plug-in component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

# ----
# Variables
# documentation
toggle = BooleanToggle(True)
# Variables description: Io = Hourly Extraterrestrial Radiation
# Isc = Solar constant (1367W/m2)
# Eo = eccentricity correction factor
# Lat  = latitude of location
# Dec = declination angle (in degrees)
# w = hour angle
# n = number of the julian day
# AST = local solar time
# d = day angle
# ET (min) = equation of time
# LST° = local standart time
# Ls° = standard meridian for a local zone (if west positive and east negative)
# L° = longitude of the location (if west positive and east negative)
# Z = zenith angle (must be between zero and 90 degrees)
# Ys = solar azimuth angle
# a = solar altitude angle
# 
# ***all cosine and sine takes values in rad
open_weather_file = Ladybug_OpenEPWWeatherFile(open=toggle)  # -> epwFile; plug-in component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
importepw = Ladybug_ImportEpw(epwFile=open_weather_file)  # -> readMe, latitude, location, dryBulbTemperature, dewPointTemperature, relativeHumidity, windSpeed, windDirection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; plug-in component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

# ----
# Hour of
# the day
num = Number([0, 1, 2, 3, 4, 5, 6, 7, 8, 9, 10, 11, 12, 13, 14, 15, 16, 17, 18, 19, 20, 21, 22, 23])
panel = Panel(num)
lst = Number(panel)

# ---- group: Run simulation / Reset Data Recorders
# 1. reset data
# recorders
# 2. Run simulation
button = Button()
c_script = CSharpScript(resetToggle=button)  # inputs resetToggle: Boolean
# ---------- c_script: C# ----------
    if(resetToggle)
    {
      //going through all the objects of the grashopper document;
      foreach (object obj in GrasshopperDocument.Objects)
      {
        ///cheking only for the GH_DataRecorder T components
        if (obj is Grasshopper.Kernel.Special.GH_DataRecorder)
        {
          ///cast the T object into GH_DataRecorder
          Grasshopper.Kernel.Special.GH_DataRecorder dataDestroy = (Grasshopper.Kernel.Special.GH_DataRecorder) obj;

          ///used the nesesary methods to destroy the data and reset the rec component
          dataDestroy.DestroyRecordedData();
          dataDestroy.ExpireSolution(true);

        }
      }
    }
# ---------- end c_script ----------

# ----
# Location
# characteristics
explodelocation = Ladybug_DecomposeLocation(location=importepw.location)  # -> locationName, latitude, longitude, timeZone, elevation; plug-in component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
panel_2 = Panel(explodelocation.locationName)
expression = Expression(x=explodelocation.longitude, Expression="x*(-1)")
expression_2 = Expression(y=explodelocation.timeZone, Expression="y*(-1)")
multiplication = Multiplication(_15=15, B=expression_2)

# ---- group: Run simulation / Double click to true
toggle_2 = BooleanToggle(False)

# ---- group: This one there is no loop
# Day of
# the year
day_of_the_year = Slider(365, range=1..365)
fly = Ladybug_fly(inputSliders=day_of_the_year, fly=toggle_2)  # -> Vviiiiiiiiiizzz; plug-in component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
doy = Number(day_of_the_year)
rec = DataRecorder(doy, DataLimit=-10, RecordData=True)
panel_3 = Panel(rec)

# ---- group: Cosine of zenith or sin of altitude angle
# Equation
# of Time
day_angle = Expression(n=doy, Expression="360*(n-1)/365")
multiplication_2 = Multiplication(A=day_angle, B="2")
rad = Radians(Degrees=day_angle)
rad_2 = Radians(Degrees=multiplication_2)
cos = Cosine(Value=rad_2)
sin = Sine(Value=rad_2)
sin_2 = Sine(Value=rad)
cos_2 = Cosine(Value=rad)
equation_of_time = Expression(
    sin2d=sin,
    cos2d=cos,
    sind=sin_2,
    cosd=cos_2,
    Expression="229.2*(0.000075 + 0.001868*cosd - 0.032077*sind - 0.014615*cos2d - 0.04089*sin2d)")
panel_4 = Panel(equation_of_time)

# Hour angle
# Solar
# declination
solar_declination = Expression(n=doy, Expression="(2*π*(284+n))/365")
sin_3 = Sine(Value=solar_declination)
solar_declination_2 = Expression(x=sin_3, Expression="23.45*x")

# Solar time
solar_time = Expression(LST=lst, ET=panel_4, Ls=multiplication, L=expression, Expression=" LST + (ET/60)  + ((Ls - L)*4)/60")
panel_5 = Panel(solar_time)

# ---- group: Cosine of zenith or sin of altitude angle / Hour Angle
hour_angle_w = Expression(AST=panel_5, Expression="15*(AST-12)")

# ---- group: Cosine of zenith or sin of altitude angle
# Cosine
# of zenith
dec = Panel(solar_declination_2)
lat = Panel(explodelocation.latitude)
w = Panel(hour_angle_w)
rad_3 = Radians(Degrees=w)
rad_4 = Radians(Degrees=lat)
rad_5 = Radians(Degrees=dec)
cosw = Cosine(Value=rad_3)
sindec = Sine(Value=rad_5)
coslat = Cosine(Value=rad_4)
cosdec = Cosine(Value=rad_5)
sinlat = Sine(Value=rad_4)
expression_3 = Expression(
    sinLat=sinlat,
    sinDec=sindec,
    cosLat=coslat,
    cosDec=cosdec,
    cosw=cosw,
    Expression="(sinLat*sinDec) + (cosLat*cosw*cosDec)")
rec_2 = DataRecorder(expression_3, DataLimit=-10, RecordData=True)
panel_6 = Panel(rec_2)

# ---- group: Ineichen simplified Solis model
solar_constant = ValueList({"1367 W/m2": 1367, "1353 W/m2": 1353, "1366.1 W/m2": 1366.1, "I'o 1618 W/m2": 1618}, selected="I'o 1618 W/m2")
sin_e = Number(expression_3)

panel_7 = Panel(sin_e)

# ---- group: Ineichen simplified Solis model / Global solar radiation
# Global solar radiation
tg = ValueList({"0.464"}, selected="0.464")
g = ValueList({"0.402"}, selected="0.402")
global_solar_radiation = Expression(Io=solar_constant, sine=sin_e, tg=tg, g=g, Expression="if(sine <0, 0, Io*e^(-tg/(sine)^g)*sine)")
rec_3 = DataRecorder(global_solar_radiation, DataLimit=-10, RecordData=True)
panel_8 = Panel(rec_3)

# ---- group: Ineichen simplified Solis model / Beam solar radiation - DNI
# Direct Normal solar radiation
tb = ValueList({"0.606"}, selected="0.606")
b = ValueList({"0.491"}, selected="0.491")
beam_solar_radiation = Expression(Io=solar_constant, sine=sin_e, tb=tb, b=b, Expression="if(sine < 0, 0, Io*e^(-tb/(sine)^b))")
rec_4 = DataRecorder(beam_solar_radiation, DataLimit=-10, RecordData=True)
panel_9 = Panel(rec_4)

# ---- group: Ineichen simplified Solis model / Diffuse solar radiation
# Diffuse solar radiation
td = ValueList({"2.698"}, selected="2.698")
d = ValueList({"0.187"}, selected="0.187")
global_solar_radiation_2 = Expression(Io=solar_constant, sine=sin_e, td=td, d=d, Expression="if(sine < 0, 0, Io*e^(-td/(sine)^d))")
rec_5 = DataRecorder(global_solar_radiation_2, DataLimit=-10, RecordData=True)
panel_10 = Panel(rec_5)

# ----
graph = QuickGraph(panel_10)
graph_2 = QuickGraph(panel_8)
graph_3 = QuickGraph(panel_9)
sin_e_elevation_angle = Sine(Value=expression_3)

day_month_hour_calculator = Ladybug_Day_Month_Hour(HOY="4216")  # -> day, month, hour, date; plug-in component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
panel_11 = Panel(day_month_hour_calculator.date)

# ----
# Date
# builder
number_slider = Slider(0, range=0..23)
number_slider_2 = Slider(1, range=1..12)
number_slider_3 = Slider(1, range=1..31)
date = ConstructDate(Year=2018, Month=number_slider_2, Day=number_slider_3, Hour=number_slider, Minute=0, Second=0)
clean = CleanTree(RemoveNulls=True, RemoveInvalid=False, RemoveEmpty=False, Tree=date)
rec_6 = DataRecorder(DataLimit=-10, RecordData=True)

fly_2 = Ladybug_fly(inputSliders=[number_slider_3, number_slider, number_slider_2], fly=Toggle(False))  # -> Vviiiiiiiiiizzz; plug-in component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

# ---- group: True time - Hour 0 is from 00:00 to 00:59
ddate = DeconstructDate(Date=clean)  # -> Year, Month, Day, Hour, Minute, Second

# ----
addition = Addition(A=ddate.Hour, B="1")
rec_7 = DataRecorder(ddate.Hour, DataLimit=-10, RecordData=True)
panel_12 = Panel(rec_7)

# ---- group: Hour 1 is from 00:00 to 00:59
doy_hoy = Ladybug_DOY_HOY(days=ddate.Day, months=ddate.Month, hours=addition)  # -> HOY, DOY, date; plug-in component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

# ----
num_2 = Number(doy_hoy.DOY)
hoy = Number(doy_hoy.HOY)
rec_8 = DataRecorder(num_2, DataLimit=-10, RecordData=True)
shift = ShiftList(List=rec_8, Shift="-1", Wrap=True)
panel_13 = Panel(shift)
rec_9 = DataRecorder(hoy, DataLimit=-10, RecordData=True)
panel_14 = Panel(rec_9)
