# Grasshopper definition Space Syntax.gh (Grasshopper 0.9.76)
# plug-ins: ElkGHComponents, CONFIGURBANIST

path = FilePath("\\d\dfs\users\all\cnatasha\Documents\Digital Urban Simulation\Exercise 3\map.osm")
loc = Location(FilePathText=path)  # -> OSMPointData, OSMFile, LongitudeDomain, LatitudeDomain
geo = Geometry([<curve referenced from the Rhino model> x120])
explode = Explode(Curve=geo, Recursive=True)  # -> Segments, Vertices

# ---- group: Street network
osm = OSMData(OSMPointData=loc.OSMPointData, OSMFilePath=loc.OSMFile, Feature="highway", Generate3d=False, IndividualOutputs=False)  # -> Ways, FeatureKey
pline = PolyLine(Vertices=osm.Ways, Closed=False)

# ---- group: Buildings
osm_2 = OSMData(OSMPointData=loc.OSMPointData, OSMFilePath=loc.OSMFile, Feature="building", Generate3d=False, IndividualOutputs=False)  # -> Ways, FeatureKey
pline_2 = PolyLine(Vertices=osm_2.Ways, Closed=False)

# ---- group: 3D buildings
osm_3 = OSMData(OSMPointData=loc.OSMPointData, OSMFilePath=loc.OSMFile, Feature="building", Generate3d=True, IndividualOutputs=False)  # -> Ways, Buildings, FeatureKey
pline_3 = PolyLine(Vertices=osm_3.Ways, Closed=False)
geo_2 = Geometry(osm_3.Buildings)

# ----
join = JoinCurves(Curves=explode.Segments, Preserve=False)
explode_2 = Explode(Curve=join, Recursive=True)  # -> Segments, Vertices
line = Line(flatten(explode_2.Segments))
sng = StreetNetwork(StreetNetworkCurves=line, Resoultion=Slider(50, range=0..100))  # -> NetworkSegmentLines, JunctionSplitSegments

pt = Point(Point(240.2222378, 644.2022356, 0))
pt_2 = Point(Point(710.6683472, 812.5330513, 0))
srf = Surface(<surface referenced from the Rhino model>)
walker = ShortestPath(
    InternallySplitNetworkSegments=sng.JunctionSplitSegments,
    Origin=pt,
    Destination=pt_2,
    Topography=srf,
    Topographic=False,
    Visualize=Toggle(False))  # -> PathPolyline, PathLength

scale = Scale(Geometry=pline, Center=Point(0, 0, 0), Factor=Slider(0.001, range=0..0.001))  # -> Geometry, Transform
scale_2 = Scale(Geometry=pline_2, Center=Point(0, 0, 0), Factor=Slider(0.001, range=0..0.001))  # -> Geometry, Transform
line_2 = Line(sng.NetworkSegmentLines)
cp = ControlPoints(Curve=sng.NetworkSegmentLines)  # -> Points, Weights, Knots; disabled
pt_3 = Point([Point(409.9413997, 266.6787926, 0), Point(535.2879437, 409.2479648, -1.455191523e-11), Point(563.6267417, 738.6914939, 0), Point(699.4969084, 1109.124915, 0)])
points = PointList(Points=pt_3, Size=50)
networkdist = NetworkDsitanceCalculator(
    NetworkSegments=line_2,
    AttractionPoints=pt_3,
    ConsiderTheTopography=False,
    AttractorIndex=Slider(3, range=0..3),
    VisualizeDistances=Toggle(False))  # -> ConnectedNetworkSegments, Distances, DistancesToAttractorID, ColorsOfDistancesToAttractorID
genes = GenePool(Decimals=0, Maximum=100, Minimum=0, Value=[10, 26, 50, 100])
toggle = BooleanToggle(True)
proximity = Proximity(
    NetworkSegments=networkdist.ConnectedNetworkSegments,
    NetworkDistances=networkdist.Distances,
    AttractionWeights=genes,
    Visualizzation=toggle)  # -> Proximity, RelativeProximity, RelativeProximityColors
vicinity = Vicinity(
    NetworkSegments=networkdist.ConnectedNetworkSegments,
    NetworkDistances=networkdist.Distances,
    AttractionWeights=genes,
    Visualizzation=toggle)  # -> Vicinity, RelativeVicinity, RelativeVicinityColors
crv = Curve([<curve referenced from the Rhino model> x723])
plotmeasures = PlotBuildingMeasures(
    NetworkSegments=networkdist.ConnectedNetworkSegments,
    NetworkMetrics=proximity.Proximity,
    NetworkColors=proximity.RelativeProximityColors,
    BuildingPlots=crv,
    Visualize=True)  # -> PlotMeasures, SimplifiedPlots, PlotColors, ClosestStreetAddress
list = ValueList({"Walking": 0, "Cycling": 1}, selected="Walking")
list_2 = ValueList({"Spatial": 0, "Temporal": 1}, selected="Spatial")
catchment = CatchmentAnalysis(
    SpatialTemporal=list_2,
    WalkingCycling=list,
    SpatialCatchmentRadius=Slider(525, range=0..1000),
    TemporalCatchmentRadius=Slider(2, range=0..15),
    PlotMeasures=plotmeasures.PlotMeasures,
    SimplifiedPlots=plotmeasures.SimplifiedPlots,
    VisualizationSwitch=Toggle(True))  # -> ReachablePolygons, ReachedPolygonsIDNumber
